# Grasshopper definition 08-wind-around-block.gh (Grasshopper 1.0.8)
# plug-ins: Hawa

# ---- group: 01 / DOMAIN + OBSTACLE
# HAWA / WIND AROUND A BLOCK
# An editable 3D setup: Domain → voxelized Geometry + Physics + Boundaries → Case → Solve → Slice / Streamlines.
# The block and domain are internalized. No Rhino model or external files are needed. Model units: METERS.
# Start with the supplied viscous demonstration fluid (nu = 0.1 m²/s). This is a setup demonstration, not a validated atmospheric wind model.
# Double-click Run to start. Change target steps, slice index, or viscosity; false pauses; Reset clears state.
domain_meters = Box({Plane=PlaneXY(0, 0, 0), X=Domain(0, 16), Y=Domain(0, 8), Z=Domain(0, 8)})
closed_block_obstacle = Mesh(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)
length_units = ValueList({"model", "meters", "millimeters"}, selected="meters")
cell_size_model_units = Slider(0.5, range=0.25..1)
domain = HawaDomain(Box=domain_meters, CellSize=cell_size_model_units, LengthUnits=length_units)  # -> Domain, Bounds, Grid
geometry = HawaGeometry(Domain=domain.Domain, Obstacles=closed_block_obstacle)  # -> Geometry, SolidCells

# ---- group: 02 / PHYSICS + CASE
boundary = HawaBoundaries(X="inlet", X_2="outlet", Y="periodic", Y_2="periodic", Z="wall", Z_2="slip")
viscosity_m²_s = Slider(0.1, range=0.01..0.5)
physics = HawaPhysics(Speed=1, Viscosity=viscosity_m²_s, Density=1.225, Collision="regularized", LatticeMach=0.05)
case = HawaCase(Domain=domain.Domain, Geometry=geometry.Geometry, Physics=physics, Boundaries=boundary)

# ---- group: 03 / RUN ON GPU OR CPU
backend = ValueList({"auto", "mps", "cuda:0", "cpu"}, selected="auto")
run_pause = BooleanToggle(False)
reset = BooleanToggle(False)
target_iterations = Slider(300, range=25..2000)
solve = HawaSolve(Case=case, Device=backend, TargetSteps=target_iterations, Run=run_pause, Reset=reset)  # -> Solution, State, Steps, Monitor
panel = Panel(solve.Monitor)

# ---- group: 04 / RESULTS IN RHINO
streamline_seeds_edit_points = Point([Point(1, 1, 2), Point(1, 2, 2), Point(1, 3, 2), Point(1, 4, 2), Point(1, 5, 2), Point(1, 6, 2), Point(1, 7, 2)])
streamlines = HawaStreamlines(Solution=solve.Solution, Seeds=streamline_seeds_edit_points, Steps=100)
horizontal_slice_index = Slider(4, range=0..16)
slice = HawaSlice(Solution=solve.Solution, Axis=2, Index=horizontal_slice_index, Field="speed", Mean=False)  # -> Mesh, Values, Range, Valid
speed_color_range_m_s = Panel(slice.Range)
