# Grasshopper definition 10-responsive-hull-search.gh (Grasshopper 1.0.8)
# plug-ins: Hawa

# ---- group: 01 / INPUTS
fixed_tank_meters = Box({Plane=PlaneXY(0, 0, 0), X=Domain(0, 24), Y=Domain(0, 12), Z=Domain(0, 10)})
# Hawa guide / purpose: HAWA / 10
# Responsive hull search
# 
# Enable evaluation and Run search. Pause holds the current candidate; disabling cancels.
bow_fullness = Slider(0.8, range=0.4..1.6)
stern_fullness = Slider(0.8, range=0.4..1.6)
cell_size_m = Slider(0.4, range=0.25..1)
beam_draft = Slider(2, range=1..3)
fixed_length_m = Slider(8, range=6..10)
fixed_volume_m³ = Slider(6, range=4..8)

# ---- group: 02 / DOMAIN / PHYSICS
# Hawa guide / operation: START / PAUSE / RESET
# Read left to right. Inputs and controls are at the left; results are at the right.
# 
# Save a copy before editing. Wait for preparation. Enable Run only when ready. Solve: Run false pauses; Reset clears state. Evaluate/Search/Record: disabling cancels.
# 
# For recordings, set a new absolute directory before starting.
domain = HawaDomain(Box=fixed_tank_meters, CellSize=cell_size_m, LengthUnits="meters")  # -> Domain, Bounds, Grid
hull = HawaParametricHull(
    Length=fixed_length_m,
    Volume=fixed_volume_m³,
    BowFullness=bow_fullness,
    SternFullness=stern_fullness,
    BeamDraft=beam_draft,
    DeckCenter=Point(8, 6.1, 5.1))  # -> Hull, Sections, Volume, Dimensions
hull_color = ColourSwatch(SwatchColor=RGB(174, 202, 207))
flow_speed_m_s = Slider(1, range=0.5..2)
viscosity_m²_s = Slider(0.1, range=0.05..0.2)

# ---- group: 03 / GEOMETRY
panel = Panel(hull.Dimensions)
physics = HawaPhysics(Speed=flow_speed_m_s, Viscosity=viscosity_m²_s, Density=1000, Collision="regularized", LatticeMach=0.05)
boundary = HawaBoundaries(X="inlet", X_2="outlet", Y="slip", Y_2="slip", Z="slip", Z_2="slip")
# Hawa guide / limits: CHECK THE RESULT
# Single fluid, submerged hull. No waves or buoyancy. Short scores demonstrate search; they do not establish an optimum.
# 
# Use the case report and component messages. Compare physical time and fixed colour ranges.
# 
# Examples and MCP instructions: README.md and ../../docs/agents/rhino-mcp.md
geometry = HawaGeometry(Domain=domain.Domain, Obstacles=hull.Hull, CurvedWalls=False)  # -> Geometry, SolidCells
preview = CustomPreview(Geometry=hull.Hull, Material=hull_color)
bounds = HawaDomainPreview(Domain=domain.Domain)  # -> Edges, FaceCenters, Labels

# ---- group: 04 / BUILD CASE
backend = ValueList({"auto", "mps", "cuda:0", "cpu"}, selected="auto")
case = HawaCase(Domain=domain.Domain, Geometry=geometry.Geometry, Physics=physics, Boundaries=boundary)
iterations_per_candidate = Slider(200, range=40..2000)
final_averaging_window = Slider(20, range=5..100)
run_search = BooleanToggle(False)
pause = BooleanToggle(False)
cancel_evaluation = BooleanToggle(False)

# ---- group: 05 / RUN / CONTROL
upstream_seeds = Point([Point(2, 4, 4), Point(2, 4.5, 4), Point(2, 5, 4), Point(2, 5.5, 4), Point(2, 6, 4), Point(2, 6.5, 4), Point(2, 7, 4), Point(2, 7.5, 4), Point(2, 8, 4)])
evaluate = HawaEvaluate(
    Case=case,
    Device=backend,
    Iterations=iterations_per_candidate,
    AverageWindow=final_averaging_window,
    ReferenceVolume=fixed_volume_m³,
    Enable=run_search,
    Pause=pause,
    Cancel=cancel_evaluation)  # -> Fitness, Solution, Resistance, Report, Candidate
candidate_budget = Slider(5, range=2..20)

# ---- group: 06 / RESULTS / CONTROLS
fitness_minimize = Panel(evaluate.Fitness)
panel_2 = Panel(evaluate.Report)
search = HawaSearch(
    Genes=[bow_fullness, stern_fullness, beam_draft],
    Fitness=evaluate.Fitness,
    Candidate=evaluate.Candidate,
    Run=run_search,
    Pause=pause,
    Budget=candidate_budget,
    Mutation=0.15,
    RestoreBest=False)  # -> BestFitness, BestGenes, History, State
slice = HawaSlice(Solution=evaluate.Solution, Axis=2, Index=8, Field="speed", Mean=False)  # -> Mesh, Values, Range, Valid
streamlines = HawaStreamlines(Solution=evaluate.Solution, Seeds=upstream_seeds, Steps=100)

# ---- group: 07 / RESULTS / CONTROLS
panel_3 = Panel(search.History)
