# Grasshopper definition 12-local-airfoil-rc-wing.gh (Grasshopper 1.0.8)
# plug-ins: Hawa

# HAWA / LOCAL AIRFOIL AND RC WING
# Enter a NACA four-digit code, or load your own local coordinate file.
# Wing analysis uses linear lifting-line theory for attached flow. CDi is induced drag only.
# Use a measured zero-lift angle from matching section data. No stall prediction.
panel = Panel("data/naca0012.dat")
airfoil = HawaAirfoil(NACAOrFile=panel, Chord=1, Plane=PlaneXY(0, 0, 0))  # -> Profile, Airfoil, Source
span = Slider(2, range=1..4)
root_chord = Slider(0.3, range=0.1..0.8)
tip_chord = Slider(0.15, range=0.05..0.6)
tip_twist = Slider(-2, range=-8..4)
wing = HawaWing(Airfoil=airfoil.Airfoil, Span=span, RootChord=root_chord, TipChord=tip_chord, Twist=tip_twist)  # -> Wing, Sections
angle_of_attack = Slider(4, range=-6..10)
llt = HawaWingAnalysis(Span=span, RootChord=root_chord, TipChord=tip_chord, Angle=angle_of_attack, Twist=tip_twist, ZeroLiftAngle=0)  # -> CL, CDi, SpanLoads, Scope, ProfileDrag, TotalDrag
polar = HawaPolarData(File="data/polar-format.csv", Reynolds=100000, Mach=0, Angle=angle_of_attack)  # -> Polar, Cl, Cd, LiftCurve, DragPolar, Conditions, Cm, LiftDrag
cl = Panel(llt.CL)
cdi = Panel(llt.CDi)
panel_2 = Panel(llt.Scope)
# SYNTHETIC FORMAT EXAMPLE
# The sample polar demonstrates the file format only. Replace it with your own measured or computed data. Enter matching Re and Mach. Connect Polar to LLT only after checking these conditions.
section_cm = Panel(polar.Cm)
