# Grasshopper definition 13-record-and-playback.gh (Grasshopper 1.0.8)
# plug-ins: Hawa

# HAWA / RECORD AND PLAYBACK
# Set a new directory on your computer. Run records timed 3D velocity fields.
# After completion connect Manifest to Playback and change the frame index.
# Use Field Snapshot tools to view each frame. Pause stops at a batch boundary.
example = HawaExample(Example="tgv3d-bgk", Size=16)
record = BooleanToggle(False)
pause = BooleanToggle(False)
record_2 = HawaRecord(
    Case=example,
    Directory="Choose a new recording directory",
    Steps=200,
    Interval=10,
    Device="auto",
    Run=record,
    Pause=pause)  # -> Manifest, State, Solution
frame = Slider(0, range=0..20)
playback = HawaPlayback(Manifest=record_2.Manifest, Index=frame)  # -> Frame, Time
iso = HawaIsosurface(Frame=playback.Frame, Field="speed", Level=0.5, Stride=2)
panel = Panel(record_2.State)
