# Grasshopper definition 14-curved-sphere-pressure.gh (Grasshopper 1.0.8)
# plug-ins: Hawa

# ---- group: 01 / DOMAIN + OBSTACLE
length_units = ValueList({"model", "meters", "millimeters"}, selected="meters")
closed_sphere_edit_mesh = Mesh(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)
domain_meters = Box({Plane=PlaneXY(0, 0, 0), X=Domain(0, 16), Y=Domain(0, 8), Z=Domain(0, 8)})
cell_size_model_units = Slider(0.5, range=0.25..1)
domain = HawaDomain(Box=domain_meters, CellSize=cell_size_model_units, LengthUnits=length_units)  # -> Domain, Bounds, Grid
geometry = HawaGeometry(Domain=domain.Domain, Obstacles=closed_sphere_edit_mesh, CurvedWalls=True)  # -> Geometry, SolidCells

# ----
# HAWA / WIND AROUND A BLOCK
# An editable 3D setup: Domain → voxelized Geometry + Physics + Boundaries → Case → Solve → Slice / Streamlines.
# The block and domain are internalized. No Rhino model or external files are needed. Model units: METERS.
# Start with the supplied viscous demonstration fluid (nu = 0.1 m²/s). This is a setup demonstration, not a validated atmospheric wind model.
# Double-click Run to start. Change target steps, slice index, or viscosity; false pauses; Reset clears state.
geocheck = HawaGeometryCheck(Meshes=closed_sphere_edit_mesh, Spacing=0.5)  # -> ClosedValid, OpenEdges, Report
grid = HawaGridPreview(Geometry=geometry.Geometry)  # -> Voxels, Volume
colors = HawaColorMap(Palette="spectrum", Minimum=0, Maximum=4, Units="Cp")  # -> Map, Colors, Labels

# ---- group: 02 / PHYSICS + CASE
viscosity_m²_s = Slider(0.1, range=0.01..0.5)
physics = HawaPhysics(Speed=1, Viscosity=viscosity_m²_s, Density=1.225, Collision="regularized", LatticeMach=0.05)
boundary = HawaBoundaries(X="inlet", X_2="outlet", Y="periodic", Y_2="periodic", Z="wall", Z_2="slip")
case = HawaCase(Domain=domain.Domain, Geometry=geometry.Geometry, Physics=physics, Boundaries=boundary)

# ---- group: 03 / RUN ON GPU OR CPU
backend = ValueList({"auto", "mps", "cuda:0", "cpu"}, selected="auto")
target_iterations = Slider(300, range=25..2000)
run_pause = BooleanToggle(False)
reset = BooleanToggle(False)
solve = HawaSolve(Case=case, Device=backend, TargetSteps=target_iterations, Run=run_pause, Reset=reset)  # -> Solution, State, Steps, Monitor
panel = Panel(solve.Monitor)

# ----
frame = HawaFieldSnapshot(Solution=solve.Solution, Mean=False)  # -> Frame, Time
surface = HawaSurfaceField(Frame=frame.Frame, Surface=closed_sphere_edit_mesh, Field="cp", Offset=0.6, Colors=colors.Map)  # -> ColoredSurface, Valid, Values
# HAWA / 3D FLOW VISUALIZATION
# Run the solver. A shared snapshot supplies the plane, tubes and isosurface.
# Change the Color Map to spectrum or blue-green. Use fixed limits for comparisons.
# Enable Isosurface preview to inspect equal-value surfaces.
bounds = HawaDomainPreview(Domain=domain.Domain)  # -> Edges, FaceCenters, Labels
colors_2 = HawaColorMap(Palette="blue-green", Minimum=0, Maximum=1.6, Units="m/s")  # -> Map, Colors, Labels
box = Box({Plane=PlaneXY(0, 0, 0), X=Domain(1, 2), Y=Domain(1, 7), Z=Domain(1, 6)})
seeds = HawaSeedPoints(Box=box, XCount=2, YCount=8, ZCount=8)
rec = Rectangle({Plane=PlaneXY(0, 0, 2), Size=Domain2(u=0..18, v=0..8)})
plane = HawaPlaneField(Frame=frame.Frame, Rectangle=rec, Resolution=30, Field="speed", Colors=colors_2.Map, ContourLevels=[0.4, 0.8, 1.2])  # -> Mesh, Contours, Values
flow = HawaFlowDisplay(Frame=frame.Frame, Seeds=seeds, Colors=colors_2.Map, Field="speed", Steps=150, Radius=0.03, Backward=False)  # -> Lines, Tubes
# CURVED WALLS / EXPERIMENTAL
# Stationary link interpolation on a uniform lattice.
# Surface colors sample Cp at a 0.6 m outward offset. They are approximate surface values.
# Compare more than one cell size before drawing physical conclusions.
# Enable Grid Preview to inspect the occupied lattice. No local refinement is active.
iso = HawaIsosurface(Frame=frame.Frame, Field="speed", Level=0.5, Stride=2)
legend = HawaLegend(Map=colors_2.Map, Plane=PlaneXY(18, 1, 0), Height=4)  # -> Legend, Labels, Locations
