# Grasshopper definition 15-fixed-refinement.gh (Grasshopper 1.0.8)
# plug-ins: Hawa

# HAWA / EXPERIMENTAL FIXED REFINEMENT
# One 2:1 patch around a sphere. Both grids solve the same physical case with BGK.
# Run starts a fresh simulation. Pause holds at a coarse step boundary. Set Run false to cancel.
# The coarse display masks the covered interior. Two field planes show the two resolutions.
# Keep the patch interface at least two coarse cells from geometry. Compare uniform fine grids before using forces.
# This example tests coupling. It does not establish engineering accuracy.
box = Box({Plane=PlaneXY(0, 0, 0), X=Domain(0, 16), Y=Domain(0, 16), Z=Domain(0, 16)})
box_2 = Box({Plane=PlaneXY(0, 0, 0), X=Domain(4, 12), Y=Domain(4, 12), Z=Domain(4, 12)})
mesh = Mesh(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)
rec = Rectangle({Plane=PlaneXY(0, 0, 8), Size=Domain2(u=0..16, v=0..16)})
rec_2 = Rectangle({Plane=PlaneXY(4, 4, 8), Size=Domain2(u=0..8, v=0..8)})
domain = HawaDomain(Box=box, CellSize=1, LengthUnits="meters")  # -> Domain, Bounds, Grid
patch = HawaRefinementPatch(Parent=domain.Domain, Region=box_2)  # -> FineDomain, Bounds
geometry = HawaGeometry(Domain=domain.Domain, Obstacles=mesh, CurvedWalls=False)  # -> Geometry, SolidCells
geometry_2 = HawaGeometry(Domain=patch.FineDomain, Obstacles=mesh, CurvedWalls=False)  # -> Geometry, SolidCells
physics = HawaPhysics(Speed=1, Viscosity=1, Density=1.225, Collision="bgk", LatticeMach=0.05)
case = HawaCase(Domain=domain.Domain, Geometry=geometry.Geometry, Physics=physics)
case_2 = HawaCase(Domain=patch.FineDomain, Geometry=geometry_2.Geometry, Physics=physics)
run_cancel = BooleanToggle(False)
pause = BooleanToggle(False)
refine = HawaRefinedSolve(CoarseCase=case, FineCase=case_2, Steps=200, Device="auto", Run=run_cancel, Pause=pause)  # -> CoarseFrame, FineFrame, State, Report
bounds = HawaDomainPreview(Domain=domain.Domain)  # -> Edges, FaceCenters, Labels
bounds_2 = HawaDomainPreview(Domain=patch.FineDomain)  # -> Edges, FaceCenters, Labels
colors = HawaColorMap(Palette="blue-green", Minimum=0, Maximum=1.6, Units="m/s")  # -> Map, Colors, Labels
plane = HawaPlaneField(Frame=refine.CoarseFrame, Rectangle=rec, Resolution=30, Field="speed", Colors=colors.Map)  # -> Mesh, Contours, Values
plane_2 = HawaPlaneField(Frame=refine.FineFrame, Rectangle=rec_2, Resolution=30, Field="speed", Colors=colors.Map)  # -> Mesh, Contours, Values
panel = Panel(refine.Report)
