# Grasshopper definition 16-cylinder-wake-recording.gh (Grasshopper 1.0.8)
# plug-ins: Hawa

# HAWA / CYLINDER WAKE
# Set a new absolute recording directory. Run records 8000 steps; Pause suspends the worker.
# After completion move Frame from 0 to 80. The plane shows speed; tubes follow that snapshot.
# Transverse and spanwise faces are periodic. This is a thin computational strip.
# Re = 100 based on the 2 m diameter. Validate grid and domain size before using engineering results.
# The video uses an analytical cylinder mask and a small seed perturbation. This mesh example is a separate editable run.
box = Box({Plane=PlaneXY(0, 0, 0), X=Domain(0, 24), Y=Domain(0, 12), Z=Domain(0, 0.45)})
mesh = Mesh(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)
rec = Rectangle({Plane=PlaneXY(0, 0, 0.15), Size=Domain2(u=0..24, v=0..12)})
box_2 = Box({Plane=PlaneXY(0, 0, 0), X=Domain(1, 2), Y=Domain(1, 11), Z=Domain(0.1, 0.3)})
domain = HawaDomain(Box=box, CellSize=0.15, LengthUnits="meters")  # -> Domain, Bounds, Grid
geometry = HawaGeometry(Domain=domain.Domain, Obstacles=mesh, CurvedWalls=False)  # -> Geometry, SolidCells
physics = HawaPhysics(Speed=1, Viscosity=0.02, Density=1.225, Collision="bgk", LatticeMach=0.1)
boundary = HawaBoundaries(X="inlet", X_2="outlet", Y="periodic", Y_2="periodic", Z="periodic", Z_2="periodic")
case = HawaCase(Domain=domain.Domain, Geometry=geometry.Geometry, Physics=physics, Boundaries=boundary)
record_cancel = BooleanToggle(False)
pause = BooleanToggle(False)
frame = Slider(0, range=0..80)
colors = HawaColorMap(Palette="blue-green", Minimum=0, Maximum=1.6, Units="m/s")  # -> Map, Colors, Labels
bounds = HawaDomainPreview(Domain=domain.Domain)  # -> Edges, FaceCenters, Labels
seeds = HawaSeedPoints(Box=box_2, XCount=2, YCount=8, ZCount=8)
record = HawaRecord(
    Case=case,
    Directory="Choose a new absolute recording directory",
    Steps=8000,
    Interval=100,
    Device="auto",
    Run=record_cancel,
    Pause=pause)  # -> Manifest, State, Solution
playback = HawaPlayback(Manifest=record.Manifest, Index=frame)  # -> Frame, Time
plane = HawaPlaneField(Frame=playback.Frame, Rectangle=rec, Resolution=80, Field="speed", Colors=colors.Map)  # -> Mesh, Contours, Values
flow = HawaFlowDisplay(Frame=playback.Frame, Seeds=seeds, Colors=colors.Map, Field="speed", Steps=150, Radius=0.03, Backward=False)  # -> Lines, Tubes
